# Grasshopper definition 220308ParametricVaseHeroku.gh (Grasshopper 1.0.7)
# plug-ins: Kangaroo2 Components

height = Slider(12, range=0..20)
folds_vertical = Slider(83, range=0..100)
height_2 = Slider(12, range=0..20)
folds_vertical_2 = Slider(22, range=0..100)
height_3 = Slider(12, range=0..20)
folds_vertical_3 = Slider(56, range=0..100)
height_4 = Slider(12, range=0..20)
folds_vertical_4 = Slider(22, range=0..100)
folds_vertical_5 = GetNumber(folds_vertical, AtLeast=1, AtMost=1, Maximum=1.797693135e+308, Minimum=-1.797693135e+308)
height_5 = GetNumber(height, AtLeast=1, AtMost=1, Maximum=1.797693135e+308, Minimum=-1.797693135e+308, Prompt="height")
smoothness = Slider(17, range=0..20)
width = Slider(35, range=0..100)
folds_vertical_6 = GetNumber(folds_vertical_2, AtLeast=1, AtMost=1, Maximum=1.797693135e+308, Minimum=-1.797693135e+308)
folds_vertical_7 = GetNumber(folds_vertical_3, AtLeast=1, AtMost=1, Maximum=1.797693135e+308, Minimum=-1.797693135e+308)
pt = ConstructPoint(XCoordinate="60", YCoordinate=0, ZCoordinate=0)
height_6 = GetNumber(height_2, AtLeast=1, AtMost=1, Maximum=1.797693135e+308, Minimum=-1.797693135e+308, Prompt="height")
height_7 = GetNumber(height_3, AtLeast=1, AtMost=1, Maximum=1.797693135e+308, Minimum=-1.797693135e+308, Prompt="height")
folds_vertical_8 = GetNumber(folds_vertical_4, AtLeast=1, AtMost=1, Maximum=1.797693135e+308, Minimum=-1.797693135e+308)
smoothness_2 = Slider(8, range=0..20)
width_2 = Slider(42, range=0..100)
smoothness_3 = Slider(12, range=0..20)
width_3 = Slider(35, range=0..100)
folds_horizontal = Slider(12, range=0..20)
height_8 = GetNumber(height_4, AtLeast=1, AtMost=1, Maximum=1.797693135e+308, Minimum=-1.797693135e+308, Prompt="height")
pt_2 = ConstructPoint(XCoordinate="0", YCoordinate="0", ZCoordinate="0")
pt_3 = ConstructPoint(XCoordinate="20", YCoordinate=0, ZCoordinate=0)
range = Range(Domain=Domain(0, 1), Steps=folds_vertical_5)
smoothness_4 = Slider(8, range=0..20)
line = LineSDL(Start=pt, Direction=Vector(0, 0, 1), Length=height_5)
width_4 = Slider(45, range=0..100)
pt_4 = ConstructPoint(XCoordinate="40", YCoordinate=0, ZCoordinate=0)
folds_horizontal_2 = Slider(14, range=0..20)
folds_horizontal_3 = Slider(12, range=0..20)
range_2 = Range(Domain=Domain(0, 1), Steps=folds_vertical_6)
range_3 = Range(Domain=Domain(0, 1), Steps=folds_vertical_7)
width_5 = GetNumber(width, AtLeast=1, AtMost=1, Maximum=1.797693135e+308, Minimum=-1.797693135e+308)
graph = GraphMapper(
    range,
    x0=0,
    x1=1,
    y0=0,
    y1=1,
    container_name="Bezier",
    cpx=[0, 0.3634574115, 0.6767231226, 1],
    cpy=[0.04292535782, 0.2429795861, 0.08527559042, 0.03994953632])
line_2 = LineSDL(Start=pt_2, Direction=Vector(0, 0, 1), Length=height_6)
smoothness_5 = GetNumber(smoothness, AtLeast=1, AtMost=1, Maximum=1.797693135e+308, Minimum=-1.797693135e+308)
line_3 = LineSDL(Start=pt_3, Direction=Vector(0, 0, 1), Length=height_7)
folds_horizontal_4 = Slider(12, range=0..20)
range_4 = Range(Domain=Domain(0, 1), Steps=folds_vertical_8)
divide = DivideCurve(Curve=line, Count=folds_vertical_5, Kinks=False)  # -> Points, Tangents, Parameters
line_4 = LineSDL(Start=pt_4, Direction=Vector(0, 0, 1), Length=height_8)
width_6 = GetNumber(width_2, AtLeast=1, AtMost=1, Maximum=1.797693135e+308, Minimum=-1.797693135e+308)
graph_2 = GraphMapper(
    range_2,
    x0=0,
    x1=1,
    y0=0,
    y1=1,
    container_name="Bezier",
    cpx=[0, 0.2797033191, 0.7273545861, 1],
    cpy=[0.04292535782, 0.04453122616, 0.2142062783, 0.03994953632])
smoothness_6 = GetNumber(smoothness_3, AtLeast=1, AtMost=1, Maximum=1.797693135e+308, Minimum=-1.797693135e+308)
width_7 = GetNumber(width_3, AtLeast=1, AtMost=1, Maximum=1.797693135e+308, Minimum=-1.797693135e+308)
graph_3 = GraphMapper(
    range_3,
    x0=0,
    x1=1,
    y0=0,
    y1=1,
    container_name="Bezier",
    cpx=[0, 0.2797033191, 0.7273545861, 1],
    cpy=[0.04292535782, 0.04453122616, 0.2142062783, 0.03994953632])
smoothness_7 = GetNumber(smoothness_2, AtLeast=1, AtMost=1, Maximum=1.797693135e+308, Minimum=-1.797693135e+308)
folds_horizontal_5 = GetNumber(folds_horizontal, AtLeast=1, AtMost=1, Maximum=1.797693135e+308, Minimum=-1.797693135e+308)
divide_2 = DivideCurve(Curve=line_2, Count=folds_vertical_6, Kinks=False)  # -> Points, Tangents, Parameters
divide_3 = DivideCurve(Curve=line_3, Count=folds_vertical_7, Kinks=False)  # -> Points, Tangents, Parameters
width_8 = GetNumber(width_4, AtLeast=1, AtMost=1, Maximum=1.797693135e+308, Minimum=-1.797693135e+308)
graph_4 = GraphMapper(
    range_4,
    x0=0,
    x1=1,
    y0=0,
    y1=1,
    container_name="Bezier",
    cpx=[0, 0.2797033191, 0.5592290759, 1],
    cpy=[0.04292535782, 0.04453122616, 0.4617621303, 0.03994953632])
smoothness_8 = GetNumber(smoothness_4, AtLeast=1, AtMost=1, Maximum=1.797693135e+308, Minimum=-1.797693135e+308)
multiplication = Multiplication(A=graph, B=smoothness_5)
folds_horizontal_6 = GetNumber(folds_horizontal_2, AtLeast=1, AtMost=1, Maximum=1.797693135e+308, Minimum=-1.797693135e+308)
folds_horizontal_7 = GetNumber(folds_horizontal_3, AtLeast=1, AtMost=1, Maximum=1.797693135e+308, Minimum=-1.797693135e+308)
divide_4 = DivideCurve(Curve=line_4, Count=folds_vertical_8, Kinks=False)  # -> Points, Tangents, Parameters
multiplication_2 = Multiplication(A=graph, B=width_5)
circle = CircleCNR(Center=divide.Points, Normal=Vector(0, 0, 1), Radius=multiplication_2)
multiplication_3 = Multiplication(A=graph_2, B=smoothness_6)
multiplication_4 = Multiplication(A=graph_3, B=smoothness_7)
folds_horizontal_8 = GetNumber(folds_horizontal_4, AtLeast=1, AtMost=1, Maximum=1.797693135e+308, Minimum=-1.797693135e+308)
multiplication_5 = Multiplication(A=graph_2, B=width_6)
circle_2 = CircleCNR(Center=divide_2.Points, Normal=Vector(0, 0, 1), Radius=multiplication_5)
seam = Seam(Curve=reparameterize(circle), Seam=multiplication)
multiplication_6 = Multiplication(A=graph_3, B=width_7)
circle_3 = CircleCNR(Center=divide_3.Points, Normal=Vector(0, 0, 1), Radius=multiplication_6)
multiplication_7 = Multiplication(A=graph_4, B=smoothness_8)
multiplication_8 = Multiplication(A=graph_4, B=width_8)
circle_4 = CircleCNR(Center=divide_4.Points, Normal=Vector(0, 0, 1), Radius=multiplication_8)
seam_2 = Seam(Curve=reparameterize(circle_2), Seam=multiplication_3)
seam_3 = Seam(Curve=reparameterize(circle_3), Seam=multiplication_4)
depth_folding = Slider(0.15, range=0..1)
series = Series(Start=0, Step=1, Count=folds_horizontal_5)
seam_4 = Seam(Curve=reparameterize(circle_4), Seam=multiplication_7)
divide_5 = DivideCurve(Curve=seam, Count=folds_horizontal_5, Kinks=False)  # -> Points, Tangents, Parameters
depth_folding_2 = Slider(0.15, range=0..1)
depth_folding_3 = Slider(0.15, range=0..1)
series_2 = Series(Start=0, Step=folds_horizontal_5, Count=folds_vertical_5)
series_3 = Series(Start=0, Step=1, Count=folds_horizontal_6)
series_4 = Series(Start=0, Step=1, Count=folds_horizontal_7)
depth_folding_4 = Slider(0.15, range=0..1)
divide_6 = DivideCurve(Curve=seam_2, Count=folds_horizontal_6, Kinks=False)  # -> Points, Tangents, Parameters
divide_7 = DivideCurve(Curve=seam_3, Count=folds_horizontal_7, Kinks=False)  # -> Points, Tangents, Parameters
series_5 = Series(Start=0, Step=folds_horizontal_6, Count=folds_vertical_6)
series_6 = Series(Start=0, Step=folds_horizontal_7, Count=folds_vertical_7)
series_7 = Series(Start=0, Step=1, Count=folds_horizontal_8)
dispatch = Dispatch(List=divide_5.Points, DispatchPattern=[True, False])  # -> ListA, ListB
shift = ShiftList(List=series, Shift=1, Wrap=True)
divide_8 = DivideCurve(Curve=seam_4, Count=folds_horizontal_8, Kinks=False)  # -> Points, Tangents, Parameters
vec2pt = Vector2Pt(PointA=dispatch.ListB, PointB=graft(divide.Points), Unitize=False)  # -> Vector, Length
series_8 = Series(Start=0, Step=folds_horizontal_8, Count=folds_vertical_8)
dispatch_2 = Dispatch(List=divide_6.Points, DispatchPattern=[True, False])  # -> ListA, ListB
shift_2 = ShiftList(List=series_3, Shift=1, Wrap=True)
dispatch_3 = Dispatch(List=divide_7.Points, DispatchPattern=[True, False])  # -> ListA, ListB
shift_3 = ShiftList(List=series_4, Shift=1, Wrap=True)
vec2pt_2 = Vector2Pt(PointA=dispatch_2.ListB, PointB=graft(divide_2.Points), Unitize=False)  # -> Vector, Length
vec2pt_3 = Vector2Pt(PointA=dispatch_3.ListB, PointB=graft(divide_3.Points), Unitize=False)  # -> Vector, Length
series_9 = Series(Start=series_2, Step=1, Count=folds_horizontal_5)
dispatch_4 = Dispatch(List=divide_8.Points, DispatchPattern=[True, False])  # -> ListA, ListB
shift_4 = ShiftList(List=series_7, Shift=1, Wrap=True)
vec2pt_4 = Vector2Pt(PointA=dispatch_4.ListB, PointB=graft(divide_4.Points), Unitize=False)  # -> Vector, Length
multiplication_9 = Multiplication(A=vec2pt.Vector, B=depth_folding)
series_10 = Series(Start=series_5, Step=1, Count=folds_horizontal_6)
series_11 = Series(Start=series_6, Step=1, Count=folds_horizontal_7)
move = Move(Geometry=dispatch.ListB, Motion=multiplication_9)  # -> Geometry, Transform
multiplication_10 = Multiplication(A=vec2pt_2.Vector, B=depth_folding_2)
multiplication_11 = Multiplication(A=vec2pt_3.Vector, B=depth_folding_3)
series_12 = Series(Start=series_8, Step=1, Count=folds_horizontal_8)
weave = Weave(Pattern=[0, 1], Stream0=dispatch.ListA, Stream1=move.Geometry, NullGaps=False)
shift_5 = ShiftList(List=series_9, Shift=1, Wrap=True)
move_2 = Move(Geometry=dispatch_2.ListB, Motion=multiplication_10)  # -> Geometry, Transform
move_3 = Move(Geometry=dispatch_3.ListB, Motion=multiplication_11)  # -> Geometry, Transform
multiplication_12 = Multiplication(A=vec2pt_4.Vector, B=depth_folding_4)
weave_2 = Weave(Pattern=[0, 1], Stream0=dispatch_2.ListA, Stream1=move_2.Geometry, NullGaps=False)
weave_3 = Weave(Pattern=[0, 1], Stream0=dispatch_3.ListA, Stream1=move_3.Geometry, NullGaps=False)
shift_6 = ShiftList(List=series_10, Shift=1, Wrap=True)
move_4 = Move(Geometry=dispatch_4.ListB, Motion=multiplication_12)  # -> Geometry, Transform
shift_7 = ShiftList(List=series_11, Shift=1, Wrap=True)
addition = Addition(A=shift_5, B=folds_horizontal_5)
addition_2 = Addition(A=series_9, B=folds_horizontal_5)
flatten = FlattenTree(Tree=weave, Path="{0}")
lng = ListLength(List=flatten)
triangle = MeshTriangle(CornerA=series, CornerB=lng, CornerC=shift)
weave_4 = Weave(Pattern=[0, 1], Stream0=dispatch_4.ListA, Stream1=move_4.Geometry, NullGaps=False)
shift_8 = ShiftList(List=series_12, Shift=1, Wrap=True)
addition_3 = Addition(A=shift_6, B=folds_horizontal_6)
addition_4 = Addition(A=shift_7, B=folds_horizontal_7)
addition_5 = Addition(A=series_10, B=folds_horizontal_6)
addition_6 = Addition(A=series_11, B=folds_horizontal_7)
flatten_2 = FlattenTree(Tree=weave_2, Path="{0}")
lng_2 = ListLength(List=flatten_2)
triangle_2 = MeshTriangle(CornerA=series_3, CornerB=lng_2, CornerC=shift_2)
flatten_3 = FlattenTree(Tree=weave_3, Path="{0}")
lng_3 = ListLength(List=flatten_3)
triangle_3 = MeshTriangle(CornerA=series_4, CornerB=lng_3, CornerC=shift_3)
addition_7 = Addition(A=shift_8, B=folds_horizontal_8)
addition_8 = Addition(A=series_12, B=folds_horizontal_8)
flatten_4 = FlattenTree(Tree=weave_4, Path="{0}")
lng_4 = ListLength(List=flatten_4)
triangle_4 = MeshTriangle(CornerA=series_7, CornerB=lng_4, CornerC=shift_4)
quad = MeshQuad(CornerA=series_9, CornerB=shift_5, CornerC=addition, CornerD=addition_2)
quad_2 = MeshQuad(CornerA=series_10, CornerB=shift_6, CornerC=addition_3, CornerD=addition_5)
merge = Merge(Data1=flatten, Data2=pt)
quad_3 = MeshQuad(CornerA=series_11, CornerB=shift_7, CornerC=addition_4, CornerD=addition_6)
quad_4 = MeshQuad(CornerA=series_12, CornerB=shift_8, CornerC=addition_7, CornerD=addition_8)
merge_2 = Merge(Data1=flatten_2, Data2=pt_2)
merge_3 = Merge(Data1=flatten_3, Data2=pt_3)
merge_4 = Merge(Data1=flatten_4, Data2=pt_4)
merge_5 = Merge(Data1=quad, Data2=triangle)
merge_6 = Merge(Data1=quad_2, Data2=triangle_2)
merge_7 = Merge(Data1=quad_3, Data2=triangle_3)
merge_8 = Merge(Data1=quad_4, Data2=triangle_4)
conmesh = ConstructMesh(Vertices=merge, Faces=flatten(merge_5))
conmesh_2 = ConstructMesh(Vertices=merge_2, Faces=flatten(merge_6))
conmesh_3 = ConstructMesh(Vertices=merge_3, Faces=flatten(merge_7))
conmesh_4 = ConstructMesh(Vertices=merge_4, Faces=flatten(merge_8))
meshsubd = MeshFromSubD(SubD=conmesh, Density=2)
meshsubd_2 = MeshFromSubD(SubD=conmesh_2, Density=2)
meshsubd_3 = MeshFromSubD(SubD=conmesh_3, Density=2)
meshsubd_4 = MeshFromSubD(SubD=conmesh_4, Density=2)
clean = CombineClean(Meshes=meshsubd)
pt_5 = ConstructPoint(XCoordinate=0, YCoordinate=0, ZCoordinate=0)
clean_2 = CombineClean(Meshes=meshsubd_2)
clean_3 = CombineClean(Meshes=meshsubd_3)
medges = MeshEdges(Mesh=clean)  # -> NakedEdges, InteriorEdges, NonManifoldEdges
pt_6 = ConstructPoint(XCoordinate=0, YCoordinate=0, ZCoordinate=0)
clean_4 = CombineClean(Meshes=meshsubd_4)
pt_7 = ConstructPoint(XCoordinate=0, YCoordinate=0, ZCoordinate=0)
pt_8 = ConstructPoint(XCoordinate=0, YCoordinate=0, ZCoordinate=0)
medges_2 = MeshEdges(Mesh=clean_2)  # -> NakedEdges, InteriorEdges, NonManifoldEdges
medges_3 = MeshEdges(Mesh=clean_3)  # -> NakedEdges, InteriorEdges, NonManifoldEdges
join = JoinCurves(Curves=medges.NakedEdges, Preserve=False)
join_2 = JoinCurves(Curves=medges.InteriorEdges, Preserve=False)
medges_4 = MeshEdges(Mesh=clean_4)  # -> NakedEdges, InteriorEdges, NonManifoldEdges
join_3 = JoinCurves(Curves=medges_2.NakedEdges, Preserve=False)
join_4 = JoinCurves(Curves=medges_2.InteriorEdges, Preserve=False)
join_5 = JoinCurves(Curves=medges_3.NakedEdges, Preserve=False)
join_6 = JoinCurves(Curves=medges_3.InteriorEdges, Preserve=False)
merge_9 = Merge(Data1=join, Data2=join_2)  # -> flatten(Result)
curvepoint = PointOnCurve(merge_9, parameter=0.5)
pull = PullPoint(Point=curvepoint, Geometry=pt_5, ClosestOnly=True)  # -> ClosestPoint, Distance
bnd = Bounds(Numbers=pull.Distance)
remap = RemapNumbers(Value=pull.Distance, Source=bnd, Target=Domain(0, 1))  # -> Mapped, Clipped
gradient = Gradient(
    LowerLimit=0,
    UpperLimit=1,
    Parameter=remap.Mapped,
    stops=[0: RGB(53, 51, 106), 0: RGB(131, 223, 201), 0.524: RGB(255, 130, 160), 0.769: RGB(220, 0, 40)])
join_7 = JoinCurves(Curves=medges_4.NakedEdges, Preserve=False)
join_8 = JoinCurves(Curves=medges_4.InteriorEdges, Preserve=False)
swatch = ColourSwatch(SwatchColor=RGB(255, 255, 255))
merge_10 = Merge(Data1=join_3, Data2=join_4)  # -> flatten(Result)
curvepoint_2 = PointOnCurve(merge_10, parameter=0.5)
pull_2 = PullPoint(Point=curvepoint_2, Geometry=pt_6, ClosestOnly=True)  # -> ClosestPoint, Distance
bnd_2 = Bounds(Numbers=pull_2.Distance)
remap_2 = RemapNumbers(Value=pull_2.Distance, Source=bnd_2, Target=Domain(0, 1))  # -> Mapped, Clipped
merge_11 = Merge(Data1=join_5, Data2=join_6)  # -> flatten(Result)
curvepoint_3 = PointOnCurve(merge_11, parameter=0.5)
pull_3 = PullPoint(Point=curvepoint_3, Geometry=pt_7, ClosestOnly=True)  # -> ClosestPoint, Distance
bnd_3 = Bounds(Numbers=pull_3.Distance)
remap_3 = RemapNumbers(Value=pull_3.Distance, Source=bnd_3, Target=Domain(0, 1))  # -> Mapped, Clipped
gradient_2 = Gradient(
    LowerLimit=0,
    UpperLimit=1,
    Parameter=remap_2.Mapped,
    stops=[0: RGB(53, 51, 106), 0: RGB(131, 223, 201), 0.524: RGB(255, 130, 160), 0.769: RGB(220, 0, 40)])
gradient_3 = Gradient(
    LowerLimit=0,
    UpperLimit=1,
    Parameter=remap_3.Mapped,
    stops=[0: RGB(53, 51, 106), 0: RGB(131, 223, 201), 0.524: RGB(255, 130, 160), 0.769: RGB(220, 0, 40)])
merge_12 = Merge(Data1=join_7, Data2=join_8)  # -> flatten(Result)
curvepoint_4 = PointOnCurve(merge_12, parameter=0.5)
pull_4 = PullPoint(Point=curvepoint_4, Geometry=pt_8, ClosestOnly=True)  # -> ClosestPoint, Distance
bnd_4 = Bounds(Numbers=pull_4.Distance)
remap_4 = RemapNumbers(Value=pull_4.Distance, Source=bnd_4, Target=Domain(0, 1))  # -> Mapped, Clipped
gradient_4 = Gradient(
    LowerLimit=0,
    UpperLimit=1,
    Parameter=remap_4.Mapped,
    stops=[0: RGB(53, 51, 106), 0: RGB(131, 223, 201), 0.524: RGB(255, 130, 160), 0.769: RGB(220, 0, 40)])
c_script = CSharpScript(crv=merge_9, color=gradient)  # -> out, A; inputs crv: Curve, color: Color
# ---------- c_script: C# ----------
    var c = color.R + "," + color.G + "," + color.B;
    crv.SetUserString("color", c);
    A = crv;
# ---------- end c_script ----------
c_script_2 = CSharpScript(crv=merge_10, color=gradient_2)  # -> out, A; inputs crv: Curve, color: Color; same code as c_script
c_script_3 = CSharpScript(crv=merge_11, color=gradient_3)  # -> out, A; inputs crv: Curve, color: Color; same code as c_script
c_script_4 = CSharpScript(crv=merge_12, color=gradient_4)  # -> out, A; inputs crv: Curve, color: Color; same code as c_script

# ---- group: RH_OUT:edges
curve = Curve(flatten(c_script.A))

curve_2 = Curve(flatten(c_script_2.A))

curve_3 = Curve(flatten(c_script_3.A))

curve_4 = Curve(flatten(c_script_4.A))

# ----
preview = CustomPreview(Geometry=curve, Material=gradient)
preview_2 = CustomPreview(Geometry=curve_2, Material=gradient_2)
preview_3 = CustomPreview(Geometry=curve_4, Material=gradient_4)
preview_4 = CustomPreview(Geometry=curve_3, Material=gradient_3)
